# Grasshopper definition electrical_room_layout.gh (Grasshopper 1.0.8)
# plug-ins: RhinoCodePluginGH, ShapeDiverForGrasshopper

sddp = ShapeDiverDocumentPayload({AbsoluteTolerance=0, AngleTolerance=0, DistanceDisplayPrecision=0, GltfVersion="Gltf2", GrasshopperVersion="1.0.0008", InputGroups="{}", OutputGroups="{}", RelativeTolerance=0, RhinoVersion="8.15.25019.13001", UnitSystem=0, VersionCreated="1.22.0.0", VersionSaved="1.22.0.0"})
room_width_feet = GetNumber(Slider(3.5, range=3..20), AtLeast=1, AtMost=1, Maximum=1.797693135e+308, Minimum=-1.797693135e+308, TreeAccess=False)
transformer_count = GetInteger(Slider(0, range=0..10), AtLeast=1, AtMost=1, Maximum=2147483647, Minimum=-2147483648, TreeAccess=False)
room_length_feet = GetNumber(Slider(4, range=3..20), AtLeast=1, AtMost=1, Maximum=1.797693135e+308, Minimum=-1.797693135e+308, TreeAccess=False)
panelboard_count = GetInteger(Slider(3, range=0..10), AtLeast=1, AtMost=1, Maximum=2147483647, Minimum=-2147483648, TreeAccess=False)
suffle = GetBoolean(Toggle(True), AtLeast=1, AtMost=1, FalseValue="False", TreeAccess=False, TrueValue="True")
py3 = Python3Script(
    room_width=room_width_feet,
    room_length=room_length_feet,
    room_height="10",
    panelboard_count=panelboard_count,
    transformer_count=transformer_count,
    shuffle=suffle)  # -> out, equipment_geometry, clearance_geometry, all_equipment_geometry, room_geometry, messages
# ---------- py3: Python ----------
# Import necessary libraries
import Rhino
import math
import random

# Import grasshopper treehelper
import ghpythonlib.treehelpers as th

# Define the Point class
class Point:
    def __init__(self, x, y):
        self.x = x
        self.y = y
    
    def distance(self, other_point):
        return ((self.x - other_point.x)**2 + (self.y - other_point.y)**2)**0.5
    
    def to_gh_point(self):
        return Rhino.Geometry.Point3d(self.x, self.y, 0)
    
class Vector:
    def __init__(self, x, y):
        self.x = x
        self.y = y

    def to_gh_vector(self):
        return Rhino.Geometry.Vector3d(self.x, self.y, 0)
    
    def get_angle(self, other_vector: 'Vector') -> float: # Get the angle between two vectors
        # Calculate the angle between two vectors using the dot product formula
        dot_product = self.x * other_vector.x + self.y * other_vector.y
        
        # Calculate the magnitude of each vector
        magnitude_self = (self.x**2 + self.y**2)**0.5
        magnitude_other = (other_vector.x**2 + other_vector.y**2)**0.5
        
        # Calculate the angle in radians
        return math.acos(dot_product / (magnitude_self * magnitude_other))
    
    def rotate(self, angle: float) -> 'Vector': # Rotate the vector by a given angle in radians
        # Rotate the vector by a given angle in radians
        cos_angle = math.cos(angle)
        sin_angle = math.sin(angle)
        
        new_x = self.x * cos_angle - self.y * sin_angle
        new_y = self.x * sin_angle + self.y * cos_angle
        
        return Vector(new_x, new_y)

def inches_to_feet(inches):
    return inches / 12

# Define the Door class
class Door:
    def __init__(self, width=3, height=10, position: Point = Point(0, 0), orientation: Vector = Vector(0, 1)):
        self.width = width
        self.height = height
        self.position = position
        self.orientation = orientation
        self.thickness = inches_to_feet(4) # Thickness of the door

        self.door_geometry = self.create_rhino_geometry(door=True, clearance=False)
        self.clearance_geometry = self.create_rhino_geometry(door=False, clearance=True)
        self.geometry = [self.door_geometry, self.clearance_geometry]

    def create_rhino_geometry(self, door=True, clearance=True) -> Rhino.Geometry.Brep:
        # Initialize a list to store the geometry
        equipment_geometry = []
        
        if door:
            # Create a box geometry for the door
            min_x = self.position.x - self.width / 2 # min_x is the left side of the door
            max_x = self.position.x + self.width / 2 # max_x is the right side of the door
            min_y = self.position.y - self.thickness / 2 # min_y is the front side of the door
            max_y = self.position.y + self.thickness / 2 # max_y is the back side of the door
            min_z = 0 # min_z is the bottom of the door
            max_z = self.height # max_z is the top of the door

            door_brep = Rhino.Geometry.Brep.CreateFromBox(Rhino.Geometry.BoundingBox(min_x, min_y, min_z, max_x, max_y, max_z)) # Create a box geometry for the door
            
            # Rotate the door 45 degrees around the Z-axis by the angle of orientation at the hinge
            rotation_axis = Rhino.Geometry.Vector3d(0, 0, 1) # Z-axis
            rotation_angle = math.pi / 4 # 45 degrees in radians

            hinge_point = Rhino.Geometry.Point3d(self.position.x + self.width / 2, self.position.y - self.thickness, 0) # Hinge point is the right side of the door
            door_brep.Rotate(rotation_angle, rotation_axis, hinge_point) # Rotate the door around the hinge point

            equipment_geometry.append(door_brep)
            # print('Door geometry created')
        if clearance:
            # Create clearance geometry inside the room
            min_x = self.position.x - self.width / 2
            max_x = self.position.x + self.width / 2
            min_y = self.position.y
            max_y = self.position.y + self.width
            min_z = 0
            max_z = self.height
            clearance_brep = Rhino.Geometry.Brep.CreateFromBox(Rhino.Geometry.BoundingBox(min_x, min_y, min_z, max_x, max_y, max_z))
            equipment_geometry.append(clearance_brep)
            # print('Clearance geometry created')
        
        # Rotate the geometry around the Z-axis by the angle of orientation
        rotation_axis = Rhino.Geometry.Vector3d(0, 0, 1) # Z-axis
        rotation_angle = self.orientation.get_angle(Vector(0, 1))
        # print(f'Rotation angle: {rotation_angle}')

        if rotation_angle != 0:
            for brep in equipment_geometry:
                brep.Rotate(rotation_angle, rotation_axis, self.position.to_gh_point())

        return equipment_geometry
    
    def rotate(self, angle): # Rotate the door by a given angle in radians
        self.orientation = self.orientation.rotate(angle)
        # Update the geometry after rotation
        self.door_geometry = self.create_rhino_geometry(door=True, clearance=False)
        self.clearance_geometry = self.create_rhino_geometry(door=False, clearance=True)
        self.geometry = [self.door_geometry, self.clearance_geometry]

# Define the ElectricalEquipment base class
class ElectricalEquipment:
    def __init__(self, width, height, depth, name="", position: Point = Point(0, 0), front_clearance=3, side_clearance=0, rear_clearance=0, orientation: Vector = Vector(0, 1), geometry_copy_equipment=None):
        self.width = width
        self.height = height
        self.depth = depth
        self.name = name
        self.position = position
        # Add attributes for clearances
        self.front_clearance = front_clearance
        self.side_clearance = side_clearance
        self.rear_clearance = rear_clearance

        self.orientation = orientation

        self.clearance_geometry = self.create_rhino_geometry(clearance=True, equipment=False, geometry_copy_equipment=geometry_copy_equipment)
        self.equipment_geometry = self.create_rhino_geometry(equipment=True, clearance=False, geometry_copy_equipment=geometry_copy_equipment)
        self.geometry = self.create_rhino_geometry(equipment=True, clearance=True, geometry_copy_equipment=geometry_copy_equipment)

    def place(self):
        # Logic to place the equipment in the room
        pass

    def rotate(self, angle): # Rotate the equipment by a given angle in radians
        self.orientation = self.orientation.rotate(angle)
        # Update the geometry after rotation
        self.clearance_geometry = self.create_rhino_geometry(clearance=True, equipment=False)
        self.equipment_geometry = self.create_rhino_geometry(equipment=True, clearance=False)
        self.geometry = self.create_rhino_geometry(equipment=True, clearance=True)

    def orient(self, vector: Vector): # Orient the equipment to a given vector
        self.orientation = vector
        # Update the geometry after rotation
        self.clearance_geometry = self.create_rhino_geometry(clearance=True, equipment=False)
        self.equipment_geometry = self.create_rhino_geometry(equipment=True, clearance=False)
        self.geometry = self.create_rhino_geometry(equipment=True, clearance=True)

    def set_position(self, position: Point): # Set the position of the equipment
        old_position = self.position
        self.position = position
        # Update the geometry after rotation
        # self.clearance_geometry = self.create_rhino_geometry(clearance=True, equipment=False)
        # self.equipment_geometry = self.create_rhino_geometry(equipment=True, clearance=False)
        # self.geometry = self.create_rhino_geometry(equipment=True, clearance=True)        

        # Translate the geometry to the new position
        translation_vector = Rhino.Geometry.Vector3d(position.x - old_position.x, position.y - old_position.y, 0)
        
        for brep in self.equipment_geometry:
            brep.Translate(translation_vector)
        for brep in self.clearance_geometry:
            brep.Translate(translation_vector)
        for brep in self.geometry:
            brep.Translate(translation_vector)


    def create_rhino_geometry(self, equipment=True, clearance=True, geometry_copy_equipment=None) -> Rhino.Geometry.Brep:
        if geometry_copy_equipment:
            if equipment == True and clearance == True:
                return geometry_copy_equipment.geometry
            elif equipment == True and clearance == False:
                return geometry_copy_equipment.equipment_geometry
            elif equipment == False and clearance == True:
                return geometry_copy_equipment.clearance_geometry
            else: 
                return None

        else:
            # Create a box geometry for the equipment
            # Width should be centered at the position
            min_x = self.position.x - self.width / 2 # min_x is the left side of the equipment
            max_x = self.position.x + self.width / 2 # max_x is the right side of the equipment
            min_y = self.position.y + self.rear_clearance # min_y is the rear side of the equipment (rear clearance is added)
            max_y = self.position.y + self.depth + self.rear_clearance # max_y is the front side of the equipment (depth + rear clearance)
            min_z = 0 # min_z is the bottom of the equipment
            max_z = self.height # max_z is the top of the equipment
            if equipment: # If equipment is True, create the equipment geometry
                equipment_brep = Rhino.Geometry.Brep.CreateFromBox(
                    Rhino.Geometry.BoundingBox(min_x, min_y, min_z, max_x, max_y, max_z)) # Create a box geometry for the equipment
            
            # Create clearance geometry
            if clearance:
                clearance_brep_list = [] # Initialize a list to store clearance geometry
                if self.front_clearance > 0: 
                    # Create a box geometry for the front clearance
                    # front_clearance should be along the positive y-axis and offset from the equipment
                    min_x = self.position.x - self.width / 2 # min_x is the left side of the equipment
                    max_x = self.position.x + self.width / 2 # max_x is the right side of the equipment
                    min_y = self.position.y + self.depth + self.rear_clearance # min_y is the front side of the equipment
                    max_y = self.position.y + self.depth + self.front_clearance + self.rear_clearance # max_y is the front side of the equipment + front clearance
                    min_z = 0 # min_z is the bottom of the equipment
                    max_z = self.height # max_z is the top of the equipment
                    front_clearance_brep = Rhino.Geometry.Brep.CreateFromBox(
                        Rhino.Geometry.BoundingBox(min_x, min_y, min_z, max_x, max_y, max_z)) # Create a box geometry for the front clearance
                    clearance_brep_list.append(front_clearance_brep)

                if self.side_clearance > 0:
                    # Create a box geometry for the left side clearance
                    # side_clearance should be along the negative x-axis and offset from the equipment
                    min_x = self.position.x - self.width / 2 - self.side_clearance # min_x is the left side of the equipment - side clearance
                    max_x = self.position.x - self.width / 2 # max_x is the left side of the equipment
                    min_y = self.position.y + self.rear_clearance # min_y is the rear side of the equipment
                    max_y = self.position.y + self.depth + self.rear_clearance # max_y is the front side of the equipment
                    min_z = 0 # min_z is the bottom of te equipment
                    max_z = self.height # max_z is the top of the equipment
                    left_clearance_brep = Rhino.Geometry.Brep.CreateFromBox(
                        Rhino.Geometry.BoundingBox(min_x, min_y, min_z, max_x, max_y, max_z)) # Create a box geometry for the left side clearance

                    # Create a box geometry for the right side clearance
                    # side_clearance should be along the positive x-axis and offset from the equipment
                    min_x = self.position.x + self.width / 2 # min_x is the right side of the equipment
                    max_x = self.position.x + self.width / 2 + self.side_clearance # max_x is the right side of the equipment + side clearance
                    min_y = self.position.y + self.rear_clearance # min_y is the rear side of the equipment
                    max_y = self.position.y + self.depth + self.rear_clearance # max_y is the front side of the equipment
                    min_z = 0 # min_z is the bottom of the equipment
                    max_z = self.height # max_z is the top of the equipment
                    # Create a box geometry for the right side clearance
                    right_clearance_brep = Rhino.Geometry.Brep.CreateFromBox(
                        Rhino.Geometry.BoundingBox(min_x, min_y, min_z, max_x, max_y, max_z)) 

                    clearance_brep_list.append(left_clearance_brep)
                    clearance_brep_list.append(right_clearance_brep)

                if self.rear_clearance > 0: # If rear clearance is greater than 0
                    # Create a box geometry for the rear clearance
                    # rear_clearance should be along the negative y-axis and offset from the equipment
                    min_x = self.position.x - self.width / 2 # min_x is the left side of the equipment
                    max_x = self.position.x + self.width / 2 # max_x is the right side of the equipment
                    min_y = self.position.y # min_y is the wall 
                    max_y = self.position.y + self.rear_clearance # max_y is the rear side of the equipment
                    min_z = 0
                    max_z = self.height
                    rear_clearance_brep = Rhino.Geometry.Brep.CreateFromBox(
                        Rhino.Geometry.BoundingBox(min_x, min_y, min_z, max_x, max_y, max_z))
                
                    clearance_brep_list.append(rear_clearance_brep)

            equipment_geometry = []
            if equipment:
                equipment_geometry.append(equipment_brep)
            if clearance:
                for clearance_brep in clearance_brep_list:
                    equipment_geometry.append(clearance_brep)

            # Rotate the geometry around the Z-axis by the angle of orientation
            rotation_axis = Rhino.Geometry.Vector3d(0, 0, 1) # Z-axis
            # Angle in radians
            rotation_angle = self.orientation.get_angle(Vector(0, 1)) 
            
            # print(f'Rotation angle: {rotation_angle}')

            if rotation_angle != 0:
                for brep in equipment_geometry:
                    brep.Rotate(rotation_angle, 
                                rotation_axis, self.position.to_gh_point())
            
            # Combine the geometry if there are multiple breps
            if len(equipment_geometry) > 1:
                result_breps = Rhino.Geometry.Brep.JoinBreps(equipment_geometry, 0.001)
                if result_breps:
                    equipment_geometry = []
                    for brep in result_breps:
                        equipment_geometry.append(brep)
                print(f'Created {len(equipment_geometry)} breps')

            # Return the combined geometry
            return equipment_geometry

# Define the Panelboard subclass
class Panelboard(ElectricalEquipment):
    
    def __init__(self, width=2, height=6, depth=0.5, name="",
                 position: Point = Point(0, 0), geometry_copy_equipment=None):
        super().__init__(width, height, depth, name, position, geometry_copy_equipment=geometry_copy_equipment)
        # Additional attributes specific to panelboard
        # ...

# Define the Transformer subclass
class Transformer(ElectricalEquipment):
    def __init__(self, width=3, height=3, depth=3, name="",
                 position: Point = Point(0, 0), geometry_copy_equipment=None):
        self.rear_clearance = 0.25
        self.front_clearance = 3
        self.side_clearance = 0.25

        super().__init__(width, height, depth, name, position, 
                         self.front_clearance, self.side_clearance, 
                         self.rear_clearance, geometry_copy_equipment=geometry_copy_equipment)

# Define the ElectricalRoom class
class ElectricalRoom:
    # Initialize the electrical room with necessary attributes (e.g., dimensions, list of equipment)
    # ...
    def __init__(self, width, length, height=10, door_count=1):
        self.width = width
        self.length = length
        self.height = height
        self.door_count = door_count
        self.equipment_list = []
        self.placed_equipment = []

        self.doors = [Door() for _ in range(door_count)]

        self.interior_rectangle = self.create_interior_rectangle()
        self.wall_geometry = self.create_wall_geometry()

        self.south_wall_face = self.wall_geometry.Faces[9]
        self.north_wall_face = self.wall_geometry.Faces[7]
        self.east_wall_face = self.wall_geometry.Faces[8]
        self.west_wall_face = self.wall_geometry.Faces[6]
    
    # Method to add equipment to the room
    def add_equipment(self, equipment: ElectricalEquipment, count=1) -> bool:
        for i in range(count):
            self.equipment_list.append(equipment)
        return True
    
    def create_interior_rectangle(self) -> Rhino.Geometry.Rectangle3d:
        # Create a rectangle for the room
        min_x = -self.width / 2
        max_x = self.width / 2
        min_y = -self.length / 2
        max_y = self.length / 2

        return Rhino.Geometry.Rectangle3d(Rhino.Geometry.Plane.WorldXY, 
                                           Rhino.Geometry.Point3d(min_x, min_y, 0), 
                                           Rhino.Geometry.Point3d(max_x, max_y, 0))
    
    def create_exterior_rectangle(self, wall_thickness) -> Rhino.Geometry.Rectangle3d:
        # Create a rectangle for the room
        min_x = -self.width / 2 - wall_thickness
        max_x = self.width / 2 + wall_thickness
        min_y = -self.length / 2 - wall_thickness
        max_y = self.length / 2 + wall_thickness

        return Rhino.Geometry.Rectangle3d(Rhino.Geometry.Plane.WorldXY,
                                           Rhino.Geometry.Point3d(min_x, min_y, 0), 
                                           Rhino.Geometry.Point3d(max_x, max_y, 0))

    # Method to create the wall geometry of the room
    def create_wall_geometry(self) -> Rhino.Geometry.Brep:
        wall_thickness = 0.5 # Thickness of the wall

        # Offset the interior rectangle to create the exterior rectangle
        interior_rectangle = self.interior_rectangle
        exterior_rectangle = self.create_exterior_rectangle(wall_thickness)

        edges = [interior_rectangle.ToNurbsCurve(), exterior_rectangle.ToNurbsCurve()]
        # Create a surface from both rectangles
        surface = Rhino.Geometry.Brep.CreatePlanarBreps(edges, 0.001)[0]

        # Extrude the surface to create the walls
        wall_brep = Rhino.Geometry.Brep.CreateFromOffsetFace(surface.Faces[0], self.height, 0.001, False, True)
        
        return wall_brep
    
    # Method to generate points and vectors around the room
    def generate_points_and_vectors(self):
        # Create Points and Vectors around the room
        points = []
        vectors = []

        # Create points around the interior rectangle
        spacing = 0.5 # Spacing between points
        interior_rectangle = self.interior_rectangle

        # Create points along the edges of the rectangle
        # It is important to note that the points are created in a clockwise direction
        # Starting from the bottom left corner

        # Create points along the bottom edge
        for i in range(int(interior_rectangle.Width / spacing) + 1):
            points.append(Point(interior_rectangle.Corner(0).X + i * spacing, interior_rectangle.Corner(0).Y))
            vectors.append(Vector(0, 1))
        # Create points along the right edge
        for i in range(int(interior_rectangle.Height / spacing) + 1):
            points.append(Point(interior_rectangle.Corner(1).X, interior_rectangle.Corner(1).Y + i * spacing))
            vectors.append(Vector(-1, 0))
        # Create points along the top edge
        for i in range(int(interior_rectangle.Width / spacing) + 1):
            points.append(Point(interior_rectangle.Corner(2).X - i * spacing, interior_rectangle.Corner(2).Y))
            vectors.append(Vector(0, -1))
        # Create points along the left edge
        for i in range(int(interior_rectangle.Height / spacing) + 1):
            points.append(Point(interior_rectangle.Corner(3).X, interior_rectangle.Corner(3).Y - i * spacing))
            vectors.append(Vector(1, 0))

        return points, vectors
    
    def place_equipment(self, point, vector, equipment: ElectricalEquipment) -> bool:
        # Logic to place the equipment in the room
        # Return True if successful, False otherwise
        
        # Update the position of the equipment
        old_position = equipment.position
        equipment.set_position(point)
        old_vector = equipment.orientation
        equipment.orient(vector)

        def revert_position():
            equipment.set_position(old_position)
            equipment.orient(old_vector)

        # Check if equipment and clearance geometry intersect with the wall geometry
        # If they do, return False
        wall_intersection = False

        for e_geometry in equipment.geometry:
            intersection_result = Rhino.Geometry.Brep.CreateBooleanIntersection(self.wall_geometry, e_geometry, 0.001, False)
            if intersection_result:
                wall_intersection = True
                break
        if wall_intersection:
            print(f'Equipment {equipment.name} intersects with wall geometry at Point {point.x}, {point.y}')
            revert_position()
            return False
        else:
            print(f'Equipment {equipment.name} does not intersect with wall geometry')
        
        # Check if equipment and clearance geometry intersect with other equipment
        # If they do, return False
        for placed_equipment in self.placed_equipment:
            for placed_geometry in placed_equipment.equipment_geometry:
                for e_geometry in equipment.geometry:
                    intersection_result = Rhino.Geometry.Brep.CreateBooleanIntersection(placed_geometry, e_geometry, 0.001, False)
                    if intersection_result:
                        print(f'Equipment {equipment.name} intersects with other equipment at Point {point.x}, {point.y}')
                        revert_position()
                        return False
                    else:
                        print(f'Equipment {equipment.name} does not intersect with other equipment')

        # Check if equipment geometry intersects with other clearance geometry
        # If they do, return False
        for placed_equipment in self.placed_equipment:
            for placed_geometry in placed_equipment.clearance_geometry:
                for e_geometry in equipment.equipment_geometry:
                    intersection_result = Rhino.Geometry.Brep.CreateBooleanIntersection(placed_geometry, e_geometry, 0.001, False)
                    if intersection_result:
                        print(f'Equipment {equipment.name} intersects with other clearance geometry at Point {point.x}, {point.y}')
                        revert_position()
                        return False
                    else:
                        print(f'Equipment {equipment.name} does not intersect with other clearance geometry')
        # If all checks pass, return True
        print(f'Equipment {equipment.name} placed successfully')
        return True

    # Method to layout the equipment in the room
    def layout_equipment(self, shuffle=False) -> bool:
        # Logic to layout the equipment in the room
        # Return True if successful, False otherwise
        # Create Points and Vectors around the room
        points, vectors = self.generate_points_and_vectors()

        equipment_list = self.equipment_list
        for equipment in equipment_list: print(equipment.name)
        if shuffle:
            equipment_list = random.sample(equipment_list, len(equipment_list)) # Shuffle the equipment list
            print('Equipment list shuffled')
        for equipment in equipment_list: print(equipment.name)
        # Place the equipment in the room one by one using the list of points and vectors
        for point, vector in zip(points, vectors):
            for equipment in equipment_list:
                if self.place_equipment(point, vector, equipment):
                    # If the equipment is placed successfully, add it to the placed equipment list
                    self.placed_equipment.append(equipment)
                    print(f'Equipment {equipment.name} placed at Point {point.x}, {point.y}')
                    equipment_list.remove(equipment)
                    break
        
        if len(equipment_list) == 0:
            print('All equipment placed successfully')
            return True
        else:
            print('Not all equipment placed successfully')
            return False

# OUTPUTS
equipment_geometry = []
clearance_geometry = []
all_equipment_geometry = []
room_geometry = []

output = []
messages = []

# Create an instance of ElectricalRoom
# INPUTS
# Dimensions of the room
room_width = float(room_width)
room_length = float(room_length)
room_height = float(room_height)
door_count = 1

electrical_room = ElectricalRoom(room_width, room_length,
                                    room_height, door_count)

# Create instances of Panelboard and Transformer
# INPUTS
panelboard_count = int(panelboard_count)
transformer_count = int(transformer_count)
shuffle = bool(shuffle)

# Add the panelboard and transformer to the electrical room

example_panelboard = Panelboard(name='PBX')
for i in range(panelboard_count):
    p = Panelboard(name=f'PB{i+1}', geometry_copy_equipment=example_panelboard)
    electrical_room.add_equipment(p, 1)

example_transformer = Transformer(name='TX')
for i in range(transformer_count):
    t = Transformer(name=f'T{i+1}', geometry_copy_equipment=example_transformer)
    electrical_room.add_equipment(t, 1)

# Layout the equipment in the room
layout_success = electrical_room.layout_equipment(shuffle=shuffle)
if layout_success:
    messages.append('Layout successful')
else:
    messages.append('Layout failed')

# Extract the geometry of the equipment and clearance
for equipment in electrical_room.placed_equipment:
    equipment_geometry.append(equipment.equipment_geometry)
    clearance_geometry.append(equipment.clearance_geometry)
    all_equipment_geometry.append(equipment.geometry)

output.append(electrical_room.wall_geometry)
room_geometry.append(electrical_room.wall_geometry)

equipment_geometry = th.list_to_tree(equipment_geometry)
clearance_geometry = th.list_to_tree(clearance_geometry)
all_equipment_geometry = th.list_to_tree(all_equipment_geometry)
print(f'output: {output}')
output = th.list_to_tree(output)
# ---------- end py3 ----------
geo = Geometry(py3.equipment_geometry)
geo_2 = Geometry(py3.clearance_geometry)
geo_3 = Geometry(py3.room_geometry)
entwine = Entwine(
    Branch00=py3.equipment_geometry,
    Branch01=py3.clearance_geometry,
    Branch02=py3.room_geometry,
    Branch03=py3.messages,
    FlattenInputs=True)
panel = Panel(py3.messages)
preview = CustomPreview(Geometry=geo, Material=ColourSwatch(SwatchColor=RGB(59, 59, 59)))
preview_2 = CustomPreview(Geometry=geo_2, Material=ColourSwatch(SwatchColor=RGBA(255, 0, 0, 31)))
preview_3 = CustomPreview(Geometry=geo_3, Material=ColourSwatch(SwatchColor=RGB(158, 109, 109)))
context_bake = ContextBake(Content=entwine)
