# Grasshopper definition hops_test_with_electrical_room.gh (Grasshopper 1.0.8)
# plug-ins: Hops, ShapeDiverForGrasshopper

sddp = ShapeDiverDocumentPayload({AbsoluteTolerance=0, AngleTolerance=0, DistanceDisplayPrecision=0, GltfVersion="Gltf2", GrasshopperVersion="1.0.0008", InputGroups="{}", OutputGroups="{}", RelativeTolerance=0, RhinoVersion="8.16.25042.13001", UnitSystem=0, VersionCreated="1.22.0.0", VersionSaved="1.22.0.0"})
hops = Hops(
    RoomWidthFeet=3.5,
    RoomLengthFeet=4,
    PanelboardCount=3,
    TransformerCount=0,
    CacheResultsInMemory=True,
    CacheSolveResults=True,
    RemoteDefinitionLocation="C:\Users\scleb\Documents\bimsc25\GitHub\grasshopper_electrical_room_layout\gh_files\electrical_room_layout.gh",
    RemoteSolveVersion=(0, 1, 0),
    ShowInput_Enabled=False,
    ShowInput_Path=False,
    SynchronousSolve=True)  # -> Geometry, Messages
entwine = Entwine(
    Branch00=ColourSwatch(SwatchColor=RGB(59, 59, 59)),
    Branch01=ColourSwatch(SwatchColor=RGBA(255, 0, 0, 31)),
    Branch02=ColourSwatch(SwatchColor=RGBA(158, 109, 109, 200)),
    FlattenInputs=True)
preview = CustomPreview(Geometry=hops.Geometry, Material=entwine)
