# Grasshopper definition initial_test.gh (Grasshopper 1.0.8)
# plug-ins: RhinoCodePluginGH

width = Slider(2, range=1..50)
depth = Slider(0.5, range=0.5..50)

# ----
# Room Definition
width_2 = Slider(40, range=1..50)
length = Slider(20, range=1..50)
rectangle = Rectangle(Plane=PlaneXY(0, 0, 0), XSize=width_2, YSize=length, Radius=0)  # -> Rectangle, Length
geo = Geometry(rectangle.Rectangle)
offset = OffsetCurve(Curve=geo, Distance=1, Corners=1)

multiplication = Multiplication(A=width, B="-0.5")
pt = ConstructPoint(XCoordinate=multiplication, YCoordinate=0, ZCoordinate=0)
py3 = Python3Script()  # -> out, a; unedited script template
xy = XYPlane(Origin=pt)
rectangle_2 = Rectangle(Plane=xy, XSize=width, YSize=depth, Radius=0)  # -> Rectangle, Length
geo_2 = Geometry(rectangle_2.Rectangle)

# ----
# Create Walls
rulesrf = RuledSurface(CurveA=geo, CurveB=offset)
Z = UnitZ(Factor="12")
extr = Extrude(Base=rulesrf, Direction=Z)

# ----
# Create Floors
panel = Panel("-1")
boundary = BoundarySurfaces(Edges=offset)
Z_2 = UnitZ(Factor=panel)
extr_2 = Extrude(Base=boundary, Direction=Z_2)
